# Grasshopper definition 01_layout2D.gh (Grasshopper 1.0.8)
# plug-ins: Dragonfly3D

# ----
# Dragonfly3D
# example 01
# 2D layout exploration
# 1. Draw points in Rhino
# on the appropriate layers
# for supports, loads, and nodes.
pipeline = GeometryPipeline(
    GroupByLayer=False,
    GroupByType=False,
    IncludeHidden=True,
    IncludeLocked=True,
    LayerFilter="nodes",
    NameFilter="*",
    SublayerFiltering=True,
    TypeFilter=1)
pipeline_2 = GeometryPipeline(
    GroupByLayer=False,
    GroupByType=False,
    IncludeHidden=True,
    IncludeLocked=True,
    LayerFilter="supports",
    NameFilter="*",
    SublayerFiltering=True,
    TypeFilter=1)
pipeline_3 = GeometryPipeline(
    GroupByLayer=False,
    GroupByType=False,
    IncludeHidden=True,
    IncludeLocked=True,
    LayerFilter="loads",
    NameFilter="*",
    SublayerFiltering=True,
    TypeFilter=1)

# ----
# 2. Generate a ground structure
# from all the points.
# Optionally, you can add additional
# lines to the ground structure.
merge = Merge(Data1=pipeline, Data2=pipeline_2, Data3=pipeline_3)
gengs = GenerateGroundStructure(Points=merge)

# ----
# 5. Define the load nodes and
# specify the applied loads as an vector.
Z = Slider(-1, range=-3..3)
vec = VectorXYZ(XComponent=0, YComponent=0, ZComponent=Z)  # -> Vector, Length
load = Load(Point=pipeline_3, Vector=vec.Vector)

# ----
# 3. Define upper and lower limits
# for the allowed bar lengths.
ub = Slider(10, range=0..15)
ub_2 = Slider(0, range=0..30)
lengthb = LengthBounds(UpperBound=ub, LowerBound=ub_2)

# ----
# 4. Define the support nodes
# and specify the degrees of freedom (DoFs)
# in each direction.
support = Support(Point=pipeline_2, FixX=True, FixY=True, FixZ=True)

# ----
# 6. Assemble everything using
# the Layout Model component.
# The computation runs automatically.
layout_model = LayoutModel(Lines=flatten(gengs), UpperLowerBounds=flatten(lengthb), BoundaryConditions=flatten([support, load]))  # -> Model, ObjectiveValue, GroundStructure

# ----
# 7. Deconstruct the Layout Model
# to extract and visualize the results.
deconmodel = DeconstructModel(Model=layout_model.Model)  # -> Lines, Points, Forces, Loads, Supports

# ----
# 8. Extract result metrics of your structure.
static_action = Panel(layout_model.ObjectiveValue)
forces = Panel(deconmodel.Forces)
bars = Panel(deconmodel.Lines)

# ----
# 9. Visualize the final structure
# in static equilibrium.
# Define custom colours
# for tension & compression.
# Visualize the ground structure.
# Visualize the indices of
# all nodes and bars.
displforce = DisplayForces(Forces=deconmodel.Forces, CColour=RGB(0, 0, 255), TColour=RGB(255, 0, 0), _0Colour=RGB(255, 255, 255))
cluster = Cluster_2(C=deconmodel.Lines)
cluster_2 = Cluster_4(C=deconmodel.Lines)  # -> M, S
cluster_3 = Cluster_3(pt=deconmodel.Points)  # -> pt_3, S
cluster_4 = Cluster(C=layout_model.GroundStructure)
preview = CustomPreview(Geometry=cluster, Material=displforce)
# 10. Move, add, remove nodes in Rhino
# to explore different structures.
preview_2 = CustomPreview(Geometry=cluster_4, Material=ColourSwatch(SwatchColor=RGB(64, 64, 64)))
tag = TextTag(Location=cluster_2.M, Text=cluster_2.S, Colour=RGB(255, 255, 255))
tag_2 = TextTag(Location=cluster_3.pt_3, Text=cluster_3.S, Colour=RGB(255, 255, 255))

# ==== cluster Cluster
C = ClusterInput()
pipe = Pipe(Curve=C, Radius=Slider(0.01, range=0..1), Caps=0)  # -> flatten(Pipe)
P = ClusterOutput(pipe)

# ==== cluster Cluster_2
C = ClusterInput()
pipe = Pipe(Curve=C, Radius=Slider(0.03, range=0..0.5), Caps=0)  # -> flatten(Pipe)
P = ClusterOutput(pipe)

# ==== cluster Cluster_3
pt = ClusterInput()
pt_2 = Point(pt)
pt_3 = ClusterOutput(pt_2)
lng = ListLength(List=pt_2)
series = Series(Start=0, Step=1, Count=lng)
S = ClusterOutput(series)

# ==== cluster Cluster_4
C = ClusterInput()
midpt = CurveMiddle(Curve=C)
M = ClusterOutput(midpt)
lng = ListLength(List=midpt)
series = Series(Start=0, Step=1, Count=lng)
S = ClusterOutput(series)
