# Grasshopper definition 02_form-finding3D.gh (Grasshopper 1.0.8)
# plug-ins: Dragonfly3D, VGS_Lib_R8

# ----
# Dragonfly3D
# example 02
# 3D form-finding
# 1. Draw curves for input
# arch & deck in Rhino.
pipeline = GeometryPipeline(
    GroupByLayer=False,
    GroupByType=False,
    IncludeHidden=True,
    IncludeLocked=True,
    LayerFilter="arch",
    NameFilter="*",
    SublayerFiltering=True,
    TypeFilter=4)
pipeline_2 = GeometryPipeline(
    GroupByLayer=False,
    GroupByType=False,
    IncludeHidden=True,
    IncludeLocked=True,
    LayerFilter="deck",
    NameFilter="*",
    SublayerFiltering=True,
    TypeFilter=4)

# ----
# 2. Generate input for Dragonfly (lines, supports, loads).
number_slider = Slider(8, range=2..25)
divide = DivideCurve(Curve=[pipeline, pipeline_2], Count=number_slider, Kinks=False)  # -> Points, Tangents, Parameters
pline = PolyLine(Vertices=divide.Points, Closed=False)
bang = ExplodeTree(Data=divide.Points)  # -> Branch0, Branch1
intersection = SetIntersection(SetA=bang.Branch0, SetB=bang.Branch1)
explode = Explode(Curve=pline, Recursive=True)  # -> Segments, Vertices
duppt = RemoveDuplicatePts(Points=intersection, Tolerance=0.01)
difference = SetDifference(SetA=bang.Branch0, SetB=duppt)
difference_2 = SetDifference(SetA=bang.Branch1, SetB=duppt)
bang_2 = ExplodeTree(Data=explode.Segments)  # -> Branch0, Branch1
ln = Line(StartPoint=difference, EndPoint=difference_2)
merge = Merge(Data1=bang_2.Branch0, Data2=bang_2.Branch1, Data3=ln)  # -> flatten(Result)
pt = Point(difference_2)
pt_2 = Point(duppt)

# ----
# 5. Define loads and supports.
Z = Slider(-1, range=-1..1)
vec = VectorXYZ(XComponent=0, YComponent=0, ZComponent=Z)  # -> Vector, Length
pt_3 = Point(pt_2)
pt_4 = Point(pt)
support = Support(Point=pt_3, FixX=True, FixY=True, FixZ=True)
load = Load(Point=pt_4, Load=vec.Vector)

# ----
# 3. Define targets for the form-finding
# (equilibrium, length, etc.).
number_slider_2 = Slider(2.7, range=0..10)
crv = Curve(bang_2.Branch0)
crv_2 = Curve(bang_2.Branch1)
crv_3 = Curve(merge)
let = Length(Line=crv, TargetLength=number_slider_2)  # disabled
let_2 = Length(Line=crv_2, TargetLength=Slider(2.5, range=0..10))  # disabled
eqt = Equilibrium(Lines=crv_3, Forces=Slider(-2, range=-2..2))

# ----
# 4. Control node coordinates.
toggle = BooleanToggle(False)
pt_5 = Point(pt_4)
pt_6 = Point(pt_3)
cntrln = ControlNode(Point=pt_6, XDoF=True, YDoF=True, ZDoF=True)
cntrln_2 = ControlNode(Point=pt_5, XDoF=toggle, YDoF=toggle, ZDoF=True)

# ----
# 6. Assemble everything using
# the GeometryModel component.
# When TRUE,
# the computation is running.
# When the button is clicked,
# everything is reset.
toggle_2 = BooleanToggle(False)
geometry_model = GeometryModel(
    Targets=flatten([eqt, let_2, let]),
    VC=flatten([cntrln, cntrln_2]),
    BoundaryConditions=flatten([load, support]),
    StartStop=toggle_2,
    Reset=Button())  # -> Model, GlobalError, Iterations

# ----
# 7. Deconstruct the Layout Model
# to extract and visualize the results.
deconmodel = DeconstructModel(Model=geometry_model.Model)  # -> Lines, Points, Forces, Loads, Supports
error = Panel(geometry_model.GlobalError)
iterations = Panel(geometry_model.Iterations)

# ----
# 8. Visualize the final structure
# in static equilibrium.
# Define custom colours
# for tension & compression.
# Visualize the support forces.
# Visualize the loads.
res = Residual(Model=geometry_model.Model, Point=deconmodel.Supports)
col = Colour(RGB(5, 120, 191))
ma = MassAddition(Input=res)  # -> flatten(Result), PartialResults
displforce = DisplayForces(Forces=deconmodel.Forces, CColour=col, TColour=RGB(255, 0, 0), _0Colour=RGB(255, 255, 255))
cluster = Cluster(C=deconmodel.Lines)
neg = Negative(Value=ma.Result)
dispextfor = DisplayExternalForces(Point=deconmodel.Supports, Vector=neg, Colour=RGB(0, 100, 0), Thickness=2, ChangeVector=Toggle(True))
dispextfor_2 = DisplayExternalForces(Point=deconmodel.Loads, Vector=vec.Vector, Colour=RGB(0, 100, 0), Thickness=2, ChangeVector=False)
preview = CustomPreview(Geometry=cluster, Material=displforce)

# ----
# 9. Visualize the force diagram.
# The force diagram is visualized using the VGS Grasshopper plugin.
# It can be found here: https://github.com/computational-structural-design/VGS
cluster_2 = Cluster_3(_0_0=deconmodel.Loads, _0_1_2=deconmodel.Supports, D=vec.Vector, L=deconmodel.Loads, _0_1=neg)  # -> R, R_2
num = Number(deconmodel.Forces)
crv_4 = Curve(deconmodel.Lines)
pt_7 = Point(cluster_2.R)
vec_2 = Vector(cluster_2.R_2)
external_forces = _2ExternalForcesVGS(ExtForceAppPt=pt_7, ExtForceVec=vec_2)
internal_forces = _1InternalForcesVGS(EdgeLn=crv_4, EdgeMag=num)
assemble_form_diagram = _3AssembleFormDiagramVGS(IntForce=internal_forces, ExtForce=external_forces)
cluster_3 = Cluster_2(F_2=assemble_form_diagram, F=assemble_form_diagram, reset=Button())  # -> M, L, M_2, L_2, edgescol, P
tag = TextTag(Location=cluster_3.M, Text=cluster_3.L, Colour=RGB(255, 255, 255))
tag_2 = TextTag(Location=cluster_3.M_2, Text=cluster_3.L_2, Colour=RGB(255, 255, 255))
preview_2 = CustomPreview(Geometry=cluster_3.P, Material=cluster_3.edgescol)

# ==== cluster Cluster
C = ClusterInput()
pipe = Pipe(Curve=C, Radius=Slider(0.03, range=0..0.5), Caps=0)  # -> flatten(Pipe)
P = ClusterOutput(pipe)

# ==== cluster Cluster_2
F = ClusterInput()
reset = ClusterInput()
F_2 = ClusterInput()
generate_force_diagram = _4GenerateForceDiagramVGS(F=F, GlobEq=True, Reset=reset, FormFinding=False)
extract_form_diagram = _8ExtractFormDiagramVGS(F=F_2)  # -> EdgeID, EdgeLn, EdgeCol, EdgeMag, NodesID, NodePt, NodeNodeAdj, NodeEdgeAdj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
extract_force_diagram = _9ExtractForceDiagramVGS(F=generate_force_diagram)  # -> EdgeID, EdgeLn, EdgesCol, EdgeMag, EdgeID2, EdgeLn2, EdgeCol2, EdgeMag2
edgescol = ClusterOutput(extract_force_diagram.EdgesCol)
scale = Scale(Geometry=extract_force_diagram.EdgeLn, Center=Point(0, 0, 0), Factor=Slider(1, range=0..10))  # -> Geometry, Transform
vec = VectorXYZ(XComponent=Slider(40, range=0..100), YComponent=Slider(11, range=0..100), ZComponent=Slider(2, range=0..100))  # -> Vector, Length
move = Move(Geometry=scale.Geometry, Motion=vec.Vector)  # -> Geometry, Transform
midpt = CurveMiddle(Curve=extract_form_diagram.EdgeLn)
M = ClusterOutput(midpt)
midpt_2 = CurveMiddle(Curve=move.Geometry)
M_2 = ClusterOutput(midpt_2)
len = Length(Curve=extract_force_diagram.EdgeLn)
L = ClusterOutput(len)
len_2 = Length(Curve=extract_force_diagram.EdgeLn)
L_2 = ClusterOutput(len_2)
pipe = Pipe(Curve=move.Geometry, Radius=Slider(0.03, range=0..0.1), Caps=0)  # -> flatten(Pipe)
P = ClusterOutput(pipe)

# ==== cluster Cluster_3
D = ClusterInput()
L = ClusterInput()
_0_1 = ClusterInput()
_0_0 = ClusterInput()
_0_1_2 = ClusterInput()
lng = ListLength(List=L)
dup = DuplicateData(Data=D, Number=lng, Order=True)
entwine = Entwine(Branch00=_0_0, Branch01=_0_1_2, FlattenInputs=True)  # -> flatten(Result)
R = ClusterOutput(entwine)
entwine_2 = Entwine(Branch00=dup, Branch01=_0_1, FlattenInputs=True)  # -> flatten(Result)
R_2 = ClusterOutput(entwine_2)
