# Grasshopper definition 03_layout_geometry.gh (Grasshopper 1.0.8)
# plug-ins: Dragonfly3D

# ----
# Dragonfly3D
# example 03
# layout + geometry
# (exploration + refinement)
# layout step
# 1. Draw points in Rhino
# on the appropriate layers
# for supports, loads, and nodes.
# Move, add or remove
# these points to explore
# various structural concepts.
pipeline = GeometryPipeline(
    GroupByLayer=False,
    GroupByType=False,
    IncludeHidden=True,
    IncludeLocked=True,
    LayerFilter="nodes",
    NameFilter="*",
    SublayerFiltering=True,
    TypeFilter=1)
pipeline_2 = GeometryPipeline(
    GroupByLayer=False,
    GroupByType=False,
    IncludeHidden=True,
    IncludeLocked=True,
    LayerFilter="supports",
    NameFilter="*",
    SublayerFiltering=True,
    TypeFilter=1)
pipeline_3 = GeometryPipeline(
    GroupByLayer=False,
    GroupByType=False,
    IncludeHidden=True,
    IncludeLocked=True,
    LayerFilter="loads",
    NameFilter="*",
    SublayerFiltering=True,
    TypeFilter=1)

# ----
# 2. Generate a ground structure
# from all the points.
# Add a volume in which
# no structure is allowed.
# 3. Define upper and lower limits
# for the allowed bar lengths.
# 4. Define the support nodes
# and specify the degrees of freedom (DoFs)
# in each direction.
# 5. Define the load nodes and
# specify the applied loads as an vector.
merge = Merge(Data1=pipeline, Data2=pipeline_2, Data3=pipeline_3)
Z = Slider(-1, range=-3..3)
gengs = GenerateGroundStructure(Points=merge)
ub = Slider(30, range=0..30)
ub_2 = Slider(0, range=0..30)
vec = VectorXYZ(XComponent=0, YComponent=0, ZComponent=Z)  # -> Vector, Length
cluster = Cluster_4(L=gengs, C=gengs)
support = Support(Point=pipeline_2, FixX=True, FixY=True, FixZ=True)
load = Load(Point=pipeline_3, Vector=vec.Vector)
lengthb = LengthBounds(UpperBound=ub, LowerBound=ub_2)
crv = Curve(cluster)

# ----
# 6. Assemble everything using
# the Layout Model component.
# The computation runs automatically.
layout_model = LayoutModel(Lines=flatten(crv), UpperLowerBounds=flatten(lengthb), BoundaryConditions=flatten([support, load]))  # -> Model, ObjectiveValue, GroundStructure

# ----
# 7. Deconstruct the Layout Model and visualize results.
swatch = ColourSwatch(SwatchColor=RGB(64, 64, 64))
cluster_2 = Cluster_2(C=layout_model.GroundStructure)
deconmodel = DeconstructModel(Model=layout_model.Model)  # -> Lines, Points, Forces, Loads, Supports
preview = CustomPreview(Geometry=cluster_2, Material=swatch)
res = Residual(Model=layout_model.Model, Point=deconmodel.Supports)
midpt = CurveMiddle(Curve=deconmodel.Lines)
lng = ListLength(List=midpt)
series = Series(Start=0, Step=1, Count=lng)
displforce = DisplayForces(Forces=deconmodel.Forces, CColour=RGB(5, 120, 191), TColour=RGB(255, 0, 0), _0Colour=RGB(255, 255, 255))
cluster_3 = Cluster_3(I=res, L=deconmodel.Supports, L_2=deconmodel.Supports)  # -> i, L_3, i_2, L_4
cluster_4 = Cluster(C=deconmodel.Lines)
dispextfor = DisplayExternalForces(Point=cluster_3.i, Vector=cluster_3.i_2, Colour=RGB(0, 100, 0), Thickness=2, ChangeVector=False)
dispextfor_2 = DisplayExternalForces(Point=cluster_3.L_3, Vector=cluster_3.L_4, Colour=RGB(0, 100, 0), Thickness=2, ChangeVector=Toggle(False))
dispextfor_3 = DisplayExternalForces(Point=deconmodel.Loads, Vector=vec.Vector, Colour=RGB(0, 100, 0), Thickness=2, ChangeVector=False)
preview_2 = CustomPreview(Geometry=cluster_4, Material=displforce)
tag = TextTag(Location=midpt, Text=series, Colour=RGB(255, 255, 255))

# ----
# geometry step
panel = Panel("""0
1
4
5""")
item = ListItem(List=deconmodel.Lines, Index=panel, Wrap=True)

# ----
# 8. Define targets for the geometry step
# (equilibrium, length, etc.).
# Control node coordinates and bar forces.
# Define loads and supports.
# (the ones from the layout step)
Z_2 = Slider(-1, range=-1..1)
toggle = BooleanToggle(False)
vec_2 = VectorXYZ(XComponent=0, YComponent=0, ZComponent=Z_2)  # -> Vector, Length
pt = Point(deconmodel.Loads)
pt_2 = Point(pt)
pt_3 = Point(deconmodel.Supports)
crv_2 = Curve(item)
crv_3 = Curve(deconmodel.Lines)
pt_4 = Point(pt_3)
cntrlb = ControlBar(Line=deconmodel.Lines, Force=deconmodel.Forces, IsActive=Toggle(True))
let = Length(Line=crv_2, TargetLength=Slider(20, range=-1..20))
eqt = Equilibrium(Lines=crv_3, Forces=Slider(-1, range=-2..2))
cntrln = ControlNode(Point=pt_4, XDoF=True, YDoF=True, ZDoF=True)
cntrln_2 = ControlNode(Point=pt_2, XDoF=toggle, YDoF=toggle, ZDoF=True)
support_2 = Support(Point=pt_3, FixX=True, FixY=True, FixZ=True)
load_2 = Load(Point=pt, Load=vec_2.Vector)
merge_2 = Merge(Data1=let, Data2=eqt)
merge_3 = Merge(Data1=cntrlb, Data2=cntrln, Data3=cntrln_2)
merge_4 = Merge(Data1=load_2, Data2=support_2)

# ----
# 9. Assemble everything using
# the GeometryModel component.
# When TRUE,
# the computation is running.
# When the button is clicked,
# everything is reset.
toggle_2 = BooleanToggle(False)
geometry_model = GeometryModel(Targets=flatten(merge_2), VC=flatten(merge_3), BoundaryConditions=flatten(merge_4), StartStop=toggle_2, Reset=Button())  # -> Model, GlobalError, Iterations

# ----
# 10. Deconstruct the Geometry Model and visualize results.
# Visualize the loads.
deconmodel_2 = DeconstructModel(Model=geometry_model.Model)  # -> Lines, Points, Forces, Loads, Supports
error = Panel(geometry_model.GlobalError)
iterations = Panel(geometry_model.Iterations)
res_2 = Residual(Model=geometry_model.Model, Point=deconmodel_2.Supports)
ma = MassAddition(Input=res_2)  # -> flatten(Result), PartialResults
displforce_2 = DisplayForces(Forces=deconmodel_2.Forces, CColour=RGB(5, 120, 191), TColour=RGB(255, 0, 0), _0Colour=RGB(255, 255, 255))
cluster_5 = Cluster(C=deconmodel_2.Lines)
neg = Negative(Value=ma.Result)
dispextfor_4 = DisplayExternalForces(Point=deconmodel_2.Supports, Vector=neg, Colour=RGB(0, 100, 0), Thickness=2, ChangeVector=Toggle(True))
dispextfor_5 = DisplayExternalForces(Point=deconmodel_2.Loads, Vector=vec_2.Vector, Colour=RGB(0, 100, 0), Thickness=2, ChangeVector=False)
preview_3 = CustomPreview(Geometry=cluster_5, Material=displforce_2)

# ==== cluster Cluster
C = ClusterInput()
pipe = Pipe(Curve=C, Radius=Slider(0.03, range=0..0.5), Caps=0)  # -> flatten(Pipe)
P = ClusterOutput(pipe)

# ==== cluster Cluster_2
C = ClusterInput()
pipe = Pipe(Curve=C, Radius=Slider(0.01, range=0..1), Caps=0)  # -> flatten(Pipe)
P = ClusterOutput(pipe)

# ==== cluster Cluster_3
I = ClusterInput()
L = ClusterInput()
L_2 = ClusterInput()
number_slider = Slider(2, range=0..10)
item = ListItem(List=L, Index=number_slider, Wrap=True)
i = ClusterOutput(item)
cull_i = CullIndex(List=L_2, Indices=number_slider, Wrap=True)
L_3 = ClusterOutput(cull_i)
ma = MassAddition(Input=I)  # -> flatten(Result), PartialResults
neg = Negative(Value=ma.Result)
item_2 = ListItem(List=neg, Index=number_slider, Wrap=True)
i_2 = ClusterOutput(item_2)
cull_i_2 = CullIndex(List=neg, Indices=number_slider, Wrap=True)
L_4 = ClusterOutput(cull_i_2)

# ==== cluster Cluster_4
C = ClusterInput()
brep = Brep(<brep referenced from the Rhino model>)
colom = CollisionOneMany(Collider=C, Obstacles=brep)  # -> Collision, Index
L = ClusterInput()
dispatch = Dispatch(List=L, DispatchPattern=colom.Collision)  # -> ListA, ListB
B = ClusterOutput(dispatch.ListB)
