# Grasshopper definition 04_selfstressed3D.gh (Grasshopper 1.0.8)
# plug-ins: Dragonfly3D, VGS_Lib_R8

# Dragonfly3D
# example 04
# self-stressed form 3D
pt = Point(Point(20, 30, 0))
circle = CircleCNR(Center=pt, Normal=Vector(0, 0, 1), Radius=Slider(15, range=0..100))
divide = DivideCurve(Curve=circle, Count=Slider(20, range=3..40), Kinks=False)  # -> Points, Tangents, Parameters
Z = UnitZ(Factor=Slider(3, range=1..10))
neg = Negative(Value=Z)
move = Move(Geometry=pt, Motion=Z)  # -> Geometry, Transform
move_2 = Move(Geometry=pt, Motion=neg)  # -> Geometry, Transform
pline = PolyLine(Vertices=divide.Points, Closed=True)
explode = Explode(Curve=pline, Recursive=True)  # -> Segments, Vertices
ln = Line(StartPoint=divide.Points, EndPoint=move.Geometry)
ln_2 = Line(StartPoint=divide.Points, EndPoint=move_2.Geometry)
ln_3 = Line(StartPoint=move.Geometry, EndPoint=move_2.Geometry)
merge = Merge(Data1=explode.Segments, Data2=ln, Data3=ln_2, Data4=ln_3)  # -> flatten(Result)
crv = Curve(merge)
crv_2 = Curve(explode.Segments)
crv_3 = Curve(ln)
crv_4 = Curve(ln_2)
crv_5 = Curve(ln_3)
cntrlb = ControlBar(Line=crv_2, Force=Slider(-1, range=-10..10), IsActive=True)
cntrlb_2 = ControlBar(Line=crv_3, Force=Slider(1, range=-10..10), IsActive=True)
cntrlb_3 = ControlBar(Line=crv_4, Force=Slider(1, range=-10..10), IsActive=True)
cntrlb_4 = ControlBar(Line=crv_5, Force=Slider(-2, range=-10..10), IsActive=True)
eqt = Equilibrium(Lines=crv, Forces="1e-9")
merge_2 = Merge(Data1=cntrlb, Data2=cntrlb_2, Data3=cntrlb_3, Data4=cntrlb_4)  # -> flatten(Result)
geometry_model = GeometryModel(Targets=flatten(eqt), VC=flatten(merge_2), StartStop=Toggle(True), Reset=Button())  # -> Model, GlobalError, Iterations
deconmodel = DeconstructModel(Model=geometry_model.Model)  # -> Lines, Points, Forces, Loads, Supports
error = Panel(geometry_model.GlobalError)
iterations = Panel(geometry_model.Iterations)
res = Residual(Model=geometry_model.Model, Point=deconmodel.Points)
col = Colour(RGB(5, 120, 191))
ma = MassAddition(Input=res)  # -> flatten(Result), PartialResults
displforce = DisplayForces(Forces=deconmodel.Forces, CColour=col, TColour=RGB(255, 0, 0), _0Colour=RGB(255, 255, 255))
cluster = Cluster(C=deconmodel.Lines)
neg_2 = Negative(Value=ma.Result)
tag = TextTag(Location=deconmodel.Points, Text=neg_2, Colour=RGB(255, 255, 255))
dispextfor = DisplayExternalForces(Point=deconmodel.Points, Vector=neg_2, Colour=RGB(0, 100, 0), Thickness=2, ChangeVector=Toggle(True))
preview = CustomPreview(Geometry=cluster, Material=displforce)
num = Number(deconmodel.Forces)
crv_6 = Curve(deconmodel.Lines)
# The force diagram is visualized using the VGS Grasshopper plugin.
# It can be found here: https://github.com/computational-structural-design/VGS
internal_forces = _1InternalForcesVGS(EdgeLn=crv_6, EdgeMag=num)
assemble_form_diagram = _3AssembleFormDiagramVGS(IntForce=internal_forces)
cluster_2 = Cluster_2(F_2=assemble_form_diagram, F=assemble_form_diagram, reset=Button())  # -> M, L, M_2, L_2, edgescol, P
tag_2 = TextTag(Location=cluster_2.M, Text=cluster_2.L, Colour=RGB(255, 255, 255))
tag_3 = TextTag(Location=cluster_2.M_2, Text=cluster_2.L_2, Colour=RGB(255, 255, 255))
preview_2 = CustomPreview(Geometry=cluster_2.P, Material=cluster_2.edgescol)

# ==== cluster Cluster
C = ClusterInput()
pipe = Pipe(Curve=C, Radius=Slider(0.03, range=0..0.5), Caps=0)  # -> flatten(Pipe)
P = ClusterOutput(pipe)

# ==== cluster Cluster_2
F = ClusterInput()
reset = ClusterInput()
generate_force_diagram = _4GenerateForceDiagramVGS(F=F, GlobEq=True, Reset=reset, FormFinding=False)
F_2 = ClusterInput()
extract_form_diagram = _8ExtractFormDiagramVGS(F=F_2)  # -> EdgeID, EdgeLn, EdgeCol, EdgeMag, NodesID, NodePt, NodeNodeAdj, NodeEdgeAdj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
extract_force_diagram = _9ExtractForceDiagramVGS(F=generate_force_diagram)  # -> EdgeID, EdgeLn, EdgesCol, EdgeMag, EdgeID2, EdgeLn2, EdgeCol2, EdgeMag2
edgescol = ClusterOutput(extract_force_diagram.EdgesCol)
scale = Scale(Geometry=extract_force_diagram.EdgeLn, Center=Point(0, 0, 0), Factor=Slider(5.3, range=0..10))  # -> Geometry, Transform
vec = VectorXYZ(XComponent=Slider(45, range=0..100), YComponent=Slider(28, range=0..100), ZComponent=Slider(2, range=0..100))  # -> Vector, Length
move = Move(Geometry=scale.Geometry, Motion=vec.Vector)  # -> Geometry, Transform
midpt = CurveMiddle(Curve=extract_form_diagram.EdgeLn)
midpt_2 = CurveMiddle(Curve=move.Geometry)
len = Length(Curve=extract_force_diagram.EdgeLn)
len_2 = Length(Curve=extract_force_diagram.EdgeLn)
pipe = Pipe(Curve=move.Geometry, Radius=Slider(0.03, range=0..0.1), Caps=0)  # -> flatten(Pipe)
M = ClusterOutput(midpt)
L = ClusterOutput(len)
M_2 = ClusterOutput(midpt_2)
L_2 = ClusterOutput(len_2)
P = ClusterOutput(pipe)
